% Simulink data dictionary HRBData.sldd

A = 7.20598
A_Tank = 0.25
Cd = 0.8
Cr = 0.018
DV = 80
P0 = 50
Patm = 1
Pmax = 400
R_AT = 4.11
R_HA = 7
R_PM_Aku = 0.07
T_sim = 200
V0 = 0.06
V_oil = 0.1
act_time = 10
alpha = 0
g = 9.81
gamma = 1.4
m = 18000
mech_eff = 0.9
mu_AT = 0.8
mu_HA = 0.8
r = 0.5715
rho = 1.225
rho_oil = 700
vol_eff = 0.9
P1 = 55
ilk_hiz = 15